# Grasshopper definition AIO_python_B1_003_SB.gh (Grasshopper 1.0.7)
# plug-ins: LunchBox

trigger = Trigger(Interval=2000, TimerInterval=2000, Target=data_recorder)
data_recorder = DataRecorder("1", DataLimit=-10, RecordData=True)
list_length = ListLength(List=data_recorder)
panel = Panel(list_length)

xz_plane = XZPlane(Origin=Point(0, 0, 0))

# ----
# SAND BOX 003
# mAKE A mOVE
# pUSH THE bUTTON
button = Button()

circle = Circle(Plane=xz_plane, Radius=1)
boundary_surfaces = BoundarySurfaces(Edges=circle)
magic_8_ball = GhPythonScript(Play_Game=button)  # -> out, input
# ---------- magic_8_ball: Python ----------
import rhinoscriptsyntax as rs
import random

if bool:
    input = random.randint(1,9)
    if input == 1:
        print("It is certain")
    elif input == 2:
        print("Outlook good")
    elif input == 3:
        print("You may rely on it")
    elif input == 4:
        print("Ask again later")
    elif input == 5:
        print("Concentrate and ask again")
    elif input == 6:
        print("Reply hazy, try again")
    elif input == 7:
        print("My repy is no")
    elif input == 8:
        print("My sources say no")
    else:
        print("That is not a question")
        
    print("mAKE A mOVE, pUSH THE bUTTON")
# ---------- end magic_8_ball ----------
panel_2 = Panel(magic_8_ball.out)
vector_xyz = VectorXYZ(XComponent=magic_8_ball.input, YComponent=0, ZComponent=0)  # -> Vector, Length
magic_8_ball_2 = GhPythonScript(Play_Game=button)  # -> out, input; same code as magic_8_ball
move = Move(Geometry=circle, Motion=vector_xyz.Vector)  # -> Geometry, Transform
vector_xyz_2 = VectorXYZ(XComponent=0, YComponent=0, ZComponent=magic_8_ball_2.input)  # -> Vector, Length
magic_8_ball_3 = GhPythonScript(Play_Game=button)  # -> out, input; same code as magic_8_ball
vector_xyz_3 = VectorXYZ(XComponent=magic_8_ball_3.input, YComponent=0, ZComponent=0)  # -> Vector, Length
move_2 = Move(Geometry=move.Geometry, Motion=vector_xyz_2.Vector)  # -> Geometry, Transform
boolean_toggle = BooleanToggle(False)
magic_8_ball_4 = GhPythonScript(Play_Game=button)  # -> out, input; same code as magic_8_ball
vector_xyz_4 = VectorXYZ(XComponent=0, YComponent=0, ZComponent=magic_8_ball_4.input)  # -> Vector, Length
panel_3 = Panel(magic_8_ball.input)
magic_8_ball_5 = GhPythonScript(Play_Game=button)  # -> out, input; same code as magic_8_ball
move_3 = Move(Geometry=move_2.Geometry, Motion=vector_xyz_3.Vector)  # -> Geometry, Transform
vector_xyz_5 = VectorXYZ(XComponent=magic_8_ball_5.input, YComponent=0, ZComponent=0)  # -> Vector, Length
magic_8_ball_6 = GhPythonScript(Play_Game=button)  # -> out, input; same code as magic_8_ball
move_4 = Move(Geometry=move_3.Geometry, Motion=vector_xyz_4.Vector)  # -> Geometry, Transform
vector_xyz_6 = VectorXYZ(XComponent=0, YComponent=0, ZComponent=magic_8_ball_6.input)  # -> Vector, Length
magic_8_ball_7 = GhPythonScript(Play_Game=button)  # -> out, input; same code as magic_8_ball
move_5 = Move(Geometry=move_4.Geometry, Motion=vector_xyz_5.Vector)  # -> Geometry, Transform
vector_xyz_7 = VectorXYZ(XComponent=magic_8_ball_7.input, YComponent=0, ZComponent=0)  # -> Vector, Length
magic_8_ball_8 = GhPythonScript(Play_Game=button)  # -> out, input; same code as magic_8_ball
move_6 = Move(Geometry=move_5.Geometry, Motion=vector_xyz_6.Vector)  # -> Geometry, Transform
vector_xyz_8 = VectorXYZ(XComponent=0, YComponent=0, ZComponent=magic_8_ball_8.input)  # -> Vector, Length
magic_8_ball_9 = GhPythonScript(Play_Game=button)  # -> out, input; same code as magic_8_ball
move_7 = Move(Geometry=move_6.Geometry, Motion=vector_xyz_7.Vector)  # -> Geometry, Transform
vector_xyz_9 = VectorXYZ(XComponent=magic_8_ball_9.input, YComponent=0, ZComponent=0)  # -> Vector, Length
move_8 = Move(Geometry=move_7.Geometry, Motion=vector_xyz_8.Vector)  # -> Geometry, Transform
move_9 = Move(Geometry=move_8.Geometry, Motion=vector_xyz_9.Vector)  # -> Geometry, Transform
merge = Merge(
    Data1=circle,
    Data2=move.Geometry,
    Data3=move_2.Geometry,
    Data4=move_3.Geometry,
    Data5=move_4.Geometry,
    Data6=move_5.Geometry,
    Data7=move_6.Geometry,
    Data8=move_7.Geometry,
    Data9=move_8.Geometry,
    Data10=move_9.Geometry)
area = Area(Geometry=merge)  # -> Area, Centroid
surface_from_points = SurfaceFromPoints(Points=area.Centroid, UCount=Slider(5, range=0..10), Interpolate=Toggle(True))
deconstruct_brep = DeconstructBrep(Brep=surface_from_points)  # -> Faces, Edges, Vertices
construct_point = ConstructPoint(XCoordinate=0, YCoordinate=0, ZCoordinate=0)
unit_z = UnitZ(Factor=1)
curve = Curve(deconstruct_brep.Edges)
join_curves = JoinCurves(Curves=curve, Preserve=False)
line_sdl = LineSDL(Start=construct_point, Direction=unit_z, Length=1)
revolution = Revolution(Curve=join_curves, Axis=line_sdl, Domain=Domain(0, 6.283185307))
object_bake = ObjectBake(
    BakeToggle=Toggle(False),
    GeometryObjects=revolution,
    Layer="GH_Bake",
    ObjectName="GH_Obj",
    ObjectColor=RGB(255, 255, 255),
    LayerColor=RGB(255, 255, 255))
