# Grasshopper definition AIO_python_B1_004_SB.gh (Grasshopper 1.0.7)

boolean_toggle = BooleanToggle(True)  # disabled
number_slider = Slider(4.44, range=0..10)  # disabled
number_slider_2 = Slider(5, range=0..10)  # disabled
panel = Panel("2,3")  # disabled
panel_2 = Panel()  # disabled
datatypes = GhPythonScript()  # -> out, Integers, str1, str2, str3, str4, str5, bool1, bool2; disabled
# ---------- datatypes: Python ----------
import rhinoscriptsyntax as rs

#Understanding Python Data Types
"""
Numbers must start with a digit (0-9)
a dot (period) is a decimal point
hyphen (-) is a negative sign

see good and bad numbers in Python
BAD
$1.99
12,345.23
123 234 
234-234
123 Oak
(234)345-1234

You can store information for zip codes, addresses, etc later
occationally a j for complex numbers
"""

Integers = [0, -1, 999999999999]
print(Integers)

Floats = [1.1, -1.2, 12.323]
#e is power of 10
#234e1000  scientific notation

"""
Complex numbers
step off the REAL number line for a bit into the IMAGINARY!

Words (strings)
must be enclosed in ""
"double" or 'single'

careful with quotes
"""
str1 = "the dog's not that mean"
#'the dog's not that mean' (error)
# or
str2 = 'the dog says "Woof.'
# but what about
# Mary's dog says "Woof".
# escape characters
# procede with \ backslash
str3 = 'Mary\'s dog said "Woof".'
# or 
str4 = "Mary's dog said \"Woof\"."

#also \n is newline
str5 = "the old pond\nA frog jumped in,\nKerplunk!"
# \n is a line break
"""
booleans
names after George Boole
True or False
"""
bool1 = True
# or 
bool2 = False
#Type sensitive
# ---------- end datatypes ----------
number_slider_3 = Slider(36.16, range=0..100)  # disabled
# SAND BOX 004
comments = GhPythonScript()  # disabled
# ---------- comments: Python ----------
import rhinoscriptsyntax as rs

# single comment line
"""
multi 
line
comment
these are called docstrings
they often appear at the top of 
methods, funcitons, classes, or method definitions
whick are app building blocks
single triple quotes work but they have to match at each end
"""
# single line comments are green
"""
multi line comments
are brown
"""
# ---------- end comments ----------
number_slider_4 = Slider(6, range=0..10)  # disabled
merge = Merge(
    Data1=datatypes.Integers,
    Data2=datatypes.str1,
    Data3=datatypes.str2,
    Data4=datatypes.str3,
    Data5=datatypes.str4,
    Data6=datatypes.str5,
    Data7=datatypes.bool1,
    Data8=datatypes.bool2)  # disabled
variables = GhPythonScript(quantity=number_slider_4, unit_price=number_slider_3)  # -> out, extended_price; inputs quantity: Int32; disabled
# ---------- variables: Python ----------
import rhinoscriptsyntax as rs
"""
Creating and Using Variables

variable is a placeholder that may change
literal mean the same content, variable is exactly that
Quantity* Unit Pirce = Extended Price

Creating valid variable names
1. must start with letter or _
2. then you can use numbers, letters, _'s
3. case sensitive
4. cannot contail quotation marks
5. PEP * style conventions recomment lower letter and _  separaters

Camel case  adn Pascal case are commonly used

Creating variables in code
variablename = value
assign/store number, string or boolean
= is an assignment operator
x = 10
username = "Mike"
"""
#Manipulating variables
# This variable contains an integer
#quantiy = 10
# This variable contains a float
#unit_price = 1.90
# This variable contains the result of multiplying quantity times unit price
extended_price = quantity * unit_price
# Show the results
print(extended_price)
"""
Saving your work
File- Auto Save
File-Save

Running your Python all in VS Code
rt click py file in tab
choose Run Python File in Terminal
"""
# This variable contains an integer
#quantiy = 14
# This variable contains a float
#unit_price = 26.90
# This variable contains the result of multiplying quantity times unit price
extended_price = quantity * unit_price
# Show the results
print(extended_price)
# ---------- end variables ----------
panel_3 = Panel(merge)  # disabled
datatypes_2 = GhPythonScript(floatInput=number_slider, boolInput=boolean_toggle, intInput=number_slider_2, complexInput=panel, strInput=panel_2)  # -> out, floatOut, boolOut, intOut, complexOut, strOut; inputs boolInput: Boolean, intInput: Int32; disabled
# ---------- datatypes_2: Python ----------
import rhinoscriptsyntax as rs

floatOut = floatInput
boolOut = boolInput
intOut = intInput 
complexOut = complexInput
strOut =strInput

print(type(floatOut))
print(type(boolOut))
print(type(intOut))
print(type(complexOut))
print(type(strOut))
# ---------- end datatypes_2 ----------
panel_4 = Panel(variables.extended_price)  # disabled
range = Range(Domain=datatypes_2.floatOut, Steps=datatypes_2.intOut)  # disabled
merge_2 = Merge(
    Data1=datatypes_2.floatOut,
    Data2=datatypes_2.boolOut,
    Data3=datatypes_2.intOut,
    Data4=datatypes_2.complexOut,
    Data5=datatypes_2.strOut)  # disabled
panel_5 = Panel(datatypes.out)  # disabled
panel_6 = Panel(merge_2)  # disabled
panel_7 = Panel(datatypes_2.out)  # disabled
circle = Circle(Plane=PlaneXY(0, 0, 0), Radius=range)  # disabled
operators = GhPythonScript(numIn=Slider(7, range=-22..22))  # -> out, Arithmetic_operators, Python_Comparison_Operators, Boolean_operators, num; inputs numIn: Int32
# ---------- operators: Python ----------
import rhinoscriptsyntax as rs


Arithmetic_operators = ["+, -, *, /, %, **, //"]

Python_Comparison_Operators = ["<, <=, >, >=, ==, !=, is, is not"]


num = numIn
if num > 0:
    print("Positive number")
    Boolean_operators = [True]
else:
    print("Negative number")
    Boolean_operators = [False]
# ---------- end operators ----------
panel_8 = Panel(operators.out)
merge_3 = Merge(
    Data1=operators.Arithmetic_operators,
    Data2=operators.Python_Comparison_Operators,
    Data3=operators.Boolean_operators,
    Data4=operators.num)  # -> flatten(Result)
list_item = ListItem(List=merge_3, Index=0, Wrap=True)  # -> Item1, Item
panel_9 = Panel(list_item.Item)
panel_10 = Panel(list_item.Item1)
syntax = GhPythonScript(numIn=Slider(-3, range=-10..10), testNum=Slider(-3, range=-10..10))  # -> out, x, testNum; inputs numIn: Int32, testNum: Int32
# ---------- syntax: Python ----------
import rhinoscriptsyntax as rs

#code blocks
x = numIn
if x == testNum:
    print("x is the matches the test number")
else:
    print("x is ", x)
print("All done")
# ---------- end syntax ----------
merge_4 = Merge(Data1=syntax.x, Data2=syntax.testNum)
panel_11 = Panel(syntax.out)
panel_12 = Panel(merge_4)
