# Grasshopper definition AIO_python_B2_001_SB.gh (Grasshopper 1.0.7)

# Python
# all-in-one for dummies, John C. Shovic, Phd and Alan Simpson, 2nd Edition, 2021
# Book 2
# Chapter 1
# Working with Numbers, Text, and Dates
# 
# no built-in-dat
# a type for dats and time
# luckily there is a free module
# 
# Calculating Numbers with Functions
# functions take and return information
# 
# variablename = functionname(param[,param])
# i.e.
# abs()
# 
# Let's jump into Jupyter Notebooks for a spell
# Built in Python functions for Numbers
# x = 128
# y = "180"
# yy = 3
# z = 256
# print(abs(x))
# print(bin(x)) #returns converted to binary
# print(float(x))
# print(format(x, y))
# print(hex(x))
# print(max(x, yy, z))
# print(min(x, yy, z))
# print(oct(x))
# print(round(x, yy))
# print(str(x))
# print(type(x))
number_slider = Slider(-1.793, range=-5..5)

# ----
# SAND BOX
number_slider_2 = Slider(6, range=0..10)
num_text_dates = GhPythonScript(x=Slider(-72, range=-256..256), xf=Slider(4.638001, range=0..10), rnd=number_slider_2, spacer=Slider(4, range=0..10))  # -> out, absOut, formatOut, maxOut, minOut, rndOut, strOut, floatOut; inputs x: Int32, rnd: Int32
# ---------- num_text_dates: Python ----------
import rhinoscriptsyntax as rs
import math as m


absOut = (abs(x))
print(absOut)
print(type(absOut))

formatOut = (format(3, spacer))
print(formatOut)
print(type(formatOut))

maxOut = (max(x, xf))
print(maxOut)
#print(type(maxOut))

minOut = (min(x, xf))
print(minOut)
print(type(minOut))

rndOut = (round(xf, rnd))
print(rndOut)
#print(type(rndOut))

strOut = str(x)
print(strOut)
#print(type(strOut))

floatOut = (float(xf))
print(floatOut)
print(type(floatOut))

print(hex(x)) #returns converted to hexidecimal
print(type(hex(x)))
print(bin(x)) #returns converted to binary
print(type(bin(x)))
print(oct(x)) #returns converted to octal
print(type(oct(x)))
# ---------- end num_text_dates ----------
mathfunctions = GhPythonScript(x=Slider(81, range=0..100), y=Slider(3, range=0..10), z=Slider(2877.065097, range=-23232..232323))  # -> out, piOut, eOut, tauOut, sqrtOut, factorOut, floorOut, degreesOut, radiansOut; inputs x: Int32, y: Int32
# ---------- mathfunctions: Python ----------
import rhinoscriptsyntax as rs
import math

piOut = math.pi
print(piOut)
print(type(piOut))

eOut = math.e
print(eOut)
print(type(eOut))

#note that python 2.7 does not have the tau function in math module!
tauOut = math.pi * 2
print(tauOut)
print(type(tauOut))

sqrtOut = (math.sqrt(x))
print(sqrtOut)
print(type(sqrtOut))


factorOut = (math.factorial(y))
print(factorOut)
print(type(factorOut))

floorOut = (math.floor(x))
print(floorOut)
print(type(floorOut))

degreesOut = (math.degrees(y))
print(degreesOut)
print(type(degreesOut))


radiansOut = (math.radians(z))
print(radiansOut)
print(type(radiansOut))
# ---------- end mathfunctions ----------
merge = Merge(
    Data1=mathfunctions.piOut,
    Data2=mathfunctions.eOut,
    Data3=mathfunctions.tauOut,
    Data4=mathfunctions.sqrtOut,
    Data5=mathfunctions.factorOut,
    Data6=mathfunctions.floorOut,
    Data7=mathfunctions.degreesOut,
    Data8=mathfunctions.radiansOut)
merge_2 = Merge(
    Data1=num_text_dates.absOut,
    Data2=num_text_dates.formatOut,
    Data3=num_text_dates.maxOut,
    Data4=num_text_dates.minOut,
    Data5=num_text_dates.rndOut,
    Data6=num_text_dates.strOut,
    Data7=num_text_dates.floatOut)
panel = Panel(merge)
panel_2 = Panel(merge_2)
list_item = ListItem(List=merge, Index=0, Wrap=True)  # -> Item, Item1, Item2, Item3, Item4, Item5, Item6, Item7, Item8
list_item_2 = ListItem(List=merge_2, Index=0, Wrap=True)  # -> Item, Item1, Item2, Item3, Item4, Item5, Item6
number = Number(list_item.Item)
number_2 = Number(list_item.Item6)
number_3 = Number(list_item.Item2)
number_4 = Number(list_item_2.Item6)
integer = Integer(list_item_2.Item)
number_5 = Number(list_item_2.Item2)
number_6 = Number(list_item_2.Item4)
integer_2 = Integer(list_item.Item4)
integer_3 = Integer(list_item.Item3)
number_7 = Number(list_item.Item1)
number_8 = Number(list_item.Item7)
panel_3 = Panel(num_text_dates.out)
text = Text(list_item_2.Item5)
integer_4 = Integer(list_item.Item5)
text_2 = Text(list_item_2.Item1)
integer_5 = Integer(list_item_2.Item3)
panel_4 = Panel(mathfunctions.out)
construct_point = ConstructPoint(XCoordinate=0, YCoordinate=0, ZCoordinate=[integer, integer_5])
circle = Circle(Plane=construct_point, Radius=construct_point)
evaluate_curve = EvaluateCurve(Curve=reparameterize(circle), Parameter=number_5)  # -> Point, Tangent, Angle
explode_tree = ExplodeTree(Data=graft(evaluate_curve.Point))  # -> Branch0, Branch1
line = Line(StartPoint=explode_tree.Branch0, EndPoint=explode_tree.Branch1)
perp_frames = PerpFrames(Curve=line, Count=integer_3, Align=True)  # -> Frames, Parameters
loft = Loft(Curves=circle, Options={Adjust=False, Closed=False, LoftEnds=0, LoftSimp=0, LoftType=0, Rebuild=10, Refit=0.01})
volume = Volume(Geometry=loft)  # -> Volume, Centroid
vector_2pt = Vector2Pt(PointA=perp_frames.Frames, PointB=volume.Centroid, Unitize=False)  # -> Vector, Length
rotate_3d = Rotate3D(Geometry=perp_frames.Frames, Angle=number_2, Center=volume.Centroid, Axis=vector_2pt.Vector)  # -> Geometry, Transform
vector_display = VectorDisplay(Anchor=volume.Centroid, Vector=vector_2pt.Vector)
align_plane = AlignPlane(Plane=perp_frames.Frames, Direction=vector_2pt.Vector)  # -> Plane, Angle
cap_holes = CapHoles(Brep=loft)
brep_plane = BrepPlane(Brep=cap_holes, Plane=rotate_3d.Geometry)  # -> Curves, Points
boundary_surfaces = BoundarySurfaces(Edges=brep_plane.Curves)
area = Area(Geometry=boundary_surfaces)  # -> Area, Centroid
scale = Scale(Geometry=boundary_surfaces, Center=area.Centroid, Factor="1.1")  # -> Geometry, Transform
split_brep = SplitBrep(Brep=cap_holes, Cutter=scale.Geometry)

num_text_dates_2 = GhPythonScript()  # -> out
# ---------- num_text_dates_2: Python ----------
import rhinoscriptsyntax as rs

x = 128
y = "180"
yy = 3
z = 256
print(abs(x))
print(bin(x)) #returns converted to binary
print(float(x))
print(format(x, y))
print(hex(x))
print(max(x, yy, z))
print(min(x, yy, z))
print(oct(x))
print(round(x, yy))
print(str(x))
print(type(x))
# ---------- end num_text_dates_2 ----------
panel_5 = Panel(num_text_dates_2)
abs = GhPythonScript(x=number_slider)  # -> out, x, y
# ---------- abs: Python ----------
import rhinoscriptsyntax as rs

y = abs(x)
print(x)
print(y)
# ---------- end abs ----------
# Still More Math Functions
# 
# math module
# import math near the top Jupyter cell
# or use them at the command prompt
# 
# sqrt()
# import math
# z = 81
# print(math.sqrt(z))
# 
# contains many function,
# hyperbolic, powers, logarithms, angular conversions, constants, etc...
# pi and e
# 
# Some functions from the Python Math Module
# math.acos(x)
# math.atan(x)
# math.atan2(y, x)
# math.ceil(x)
# math.degrees(x)
# math.e
# math.exp(x)
# math.factorial(x)
# math.floor(x)
# math.isnan(x)
# math.log(x, y)
# math.log2(x)
# math.pi
# math.pow(x, y)
# math.radians(x)
# math.sin(x)
# math.sqrt(x)
# math.tan(x)
# math.tau()
panel_6 = Panel(abs.out)
panel_7 = Panel([abs.x, abs.y])
mathfunctions_2 = GhPythonScript(x=Slider(81, range=0..100), y=Slider(7, range=0..10), z=Slider(5011.47349, range=-23232..232323))  # -> out; inputs x: Int32, y: Int32
# ---------- mathfunctions_2: Python ----------
import rhinoscriptsyntax as rs
import math
pi = math.pi
e = math.e
#note that python 2.7 does not have the tau function in math module!
tau = math.pi * 2
print(pi)
print(e)
print(tau)
print(math.sqrt(x))
print(math.factorial(y))
print(math.floor(x))
print(math.degrees(y))
print(math.radians(45))
# ---------- end mathfunctions_2 ----------
panel_8 = Panel(mathfunctions_2)
formatting = GhPythonScript(unit_price=Slider(26.96, range=0..100), quantity=Slider(5, range=0..10))  # -> out; inputs quantity: Int32
# ---------- formatting: Python ----------
import rhinoscriptsyntax as rs

# formatting does not work with Python 2.7
#print(f"Subtotal: ${quantity * unit_price}")
#print(f"Subtotal: ${quantity * unit_price:,.2f}")

print("Subtotal: " + str(quantity * unit_price))
# ---------- end formatting ----------
formatting_2 = GhPythonScript()  # -> out
# ---------- formatting_2: Python ----------
import rhinoscriptsyntax as rs

unit_price = 49.99
quantity = 30

# formatting does not work with Python 2.7
#print(f"Subtotal: ${quantity * unit_price}")

print("Subtotal: " + str(quantity * unit_price))

# want to show dollar amounts
#Showing dollar amounts correctly
# Best to stick with VS Code or Jupyter Notebooks in my opinion
# ---------- end formatting_2 ----------
panel_9 = Panel(formatting_2)
panel_10 = Panel(formatting)
# Grappling with Weirder Numbers
# 
# binary, octal and hexadecimal
# base 2, base 8, base 16
# 
# binary 0,1 0b bin()
# Octal 0,1,2,3,4,5,6,7 0o oct()
# Hexadecimal 0,1,2...A,B,C,D,E,F 0x hex()
# 
# see converter online in browser
# Convert
# print(bin(x))
# print(oct(x))
# print(hex(x))
# 
# print(0b111111111)
# print(0o377)
# print(0xff)
# Formatting Numbers
# $ switched to use f-strings
# Formatting with f-strings
# easy
# f or F
# f"Hello {username}"
# 
# username = "Mike"
# print(f"Hello {user_name}")
# 
# unit_price = 49.99
# quantity = 30
# print(f"Subtotal: ${quantitiy * unit_price})
# 
# Showing dollar amounts
# stick with VS Code or Jupyter Notebooks
# in my opinion
# does not work in python 2.7
# unit_price = 49.99
# quantity = 30
# print(f"Subtotal: ${quantity * unit_price:,.2f}")
# 
# this produces:
# Subtotal: $1,499.70
# 
# Formatting percent numbers
# does not work in python 2.7
# unit_price = 49.99
# quantity = 30
# print(f"Subtotal: ${quantity * unit_price:,.2f}")
# 
# Formatting percent numbers
# stick with VS Code or Jupyter Notebooks
# python 2.7 formatting is different and not worth learning in my opinion
# 
# sales_tax_rate = 0.065
# print(f"Sales Tax Rate {sales_tax_rate:.2%}")
# print(f"Sales Tax Rate {sales_tax_rate:.1%}")
# print(f"Sales Tax Rate {sales_tax_rate:.9%}")
# 
# Making multiline format strings
# use \n
# user1 = "Oscar"
# user2 = "Max"
# user3 = "Ella"
# output = f"{user1} \n{user2} \n{user3}"
# print(output)
# or
# output = f"""
# First: {user1}
# Second: {user2}
# Third: {user3}
# """
# print(output)
# 
# unit_price = 49.95
# quantity = 32
# sales_tax_rate = 0.065
# Subtotal= quantity * unit_price
# sales_tax = sales_tax_rate * Subtotal
# total = Subtotal + sales_tax
# output = f"""
# Subtotal:   ${Subtotal:,.2f}
# Sales Tax:  ${sales_tax:,.2f}
# Total:      ${total:,.2f}
# """
# print(output)
# 
# #Formatting width and alignment
# # <> left or right alignment code
# unit_price = 49.95
# quantity = 32
# sales_tax_rate = 0.065
# Subtotal= quantity * unit_price
# sales_tax = sales_tax_rate * Subtotal
# total = Subtotal + sales_tax
# output = f"""
# Subtotal:   ${Subtotal:>9,.2f}
# Sales Tax:  ${sales_tax:>9,.2f}
# Total:      ${total:>9,.2f}
# """
# print(output)
# 
# #realign dollar sign as well
# #complicated but not impossible
# # use + with strings you concatenate, not add
# unit_price = 49.95
# quantity = 32
# sales_tax_rate = 0.065
# subtotal = quantity * unit_price
# sales_tax = sales_tax_rate * subtotal
# total = subtotal + sales_tax
# 
# # Format amounts to show as string with Leading dollar sign
# s_subtotal = "$" + f"{subtotal:,.2f}"
# s_sales_tax = "$" + f"{sales_tax:,.2f}"
# s_total = "$" + f"{total:,.2f}"
# 
# # Output the string with dollar sign already attached
# output = f"""
# Subtotal:   {s_subtotal:>9}
# Sales Tax:  {s_sales_tax:>9}
# Total:      {s_total:>9}
# """
# print(output)
# Complex numbers
# 
# good for electrical engineering and higher math
# 
# a+bi
# a,b are Real numbers
# i is imaginary sqrt(-1)
# Python uses j instead of i
# complex() function
# complex(real, imaginary)
# z = complex(2, -3)
# print(z)
# 2-3j
# you can track .real or .imag
# print(z.real)
# print(z.imag
# 
# search your browser for python cmath
# cmath module
number_slider_3 = Slider(220, range=0..1000)
panel_11 = Panel("255")
complexfunction = GhPythonScript(realNum=Slider(3, range=0..10), imagNum=Slider(4.33, range=0..10))  # -> out, complexOut
# ---------- complexfunction: Python ----------
import rhinoscriptsyntax as rs

#Complex numbers

#good for electrical engineering and higher math 
"""
a+bi
a,b are Real numbers
i is imaginary sqrt(-1)
Python uses j instead of i
complex() function
complex(real, imaginary)
"""
z = complex(2, -3)
print(z)
#2-3j
#you can track .real or .imag
print(z.real)
print(z.imag)
"""
search your browser for python cmath
cmath module
"""
complexOut = z
# ---------- end complexfunction ----------
weird_numbers = GhPythonScript(x=number_slider_3)  # -> out; inputs x: Int32
# ---------- weird_numbers: Python ----------
import rhinoscriptsyntax as rs

#Convert
print(bin(x))
print(oct(x))
print(hex(x))

print(0b111111111)
print(0o377)
print(0xff)
# ---------- end weird_numbers ----------
panel_12 = Panel(weird_numbers)
panel_13 = Panel(complexfunction.out)
panel_14 = Panel(complexfunction.complexOut)

# ----
# Manipulating Strings
# 
# string of characters
# 
# Concatenating strings
# + sign joins strings
# 
# first_name = "Mike"
# middle_name = Elvis"
# last_name = "Wickerson"
# full_name = first_name+middle_name+last_name
# print(full_name)
# Uncovering Dates and Times
# 
# datetime module
# import datetime as dt
# 
# datetime.date
# datetime.time
# datetime.datetime
# 
# Working with dates
# today() method
# 2020, 4, 1
# 2020, 04, 01 won't work
# 
# date.today()
# date(year, month, day)
# 
# can use:
# .month, .day, .year
# 
# Formatting String for Dates and Times
# look up online, too many
# %a, %A, %w,...%%
# 
# prefer f-strings over strftime
# 
# Sample Date Format Strings
# 
# Working with times
# Sample Date Format Strings
# 
# now() method
# Sample Datetime Format Strings
# + " " + in between variables for spaces
# 
# Getting the length of string
# 
# len() built-in function
# includes spaces
# 
# s1 = ""
# s2 = " "
# s3 = A B C"
# print(s1)
# print(s2)
# print(s3)
# 
# Working with common string operators
# start counting with 0 not 1
# ABCDE
# 01 23 4
# 
# Python Sequence Operators That Work with Strings
# x in s           returns True if x in s
# x not in s    returns True if x is not in s
# s * n or n * s   repeats n times
# s[i]              ith item of string s, first char is 0
# s[i : j]          slice i thru j from string x
# s[i : j : k]     slice i to j with step k
# min(s)       find smallest(lowest) char fo string s
# max(s)
# s.index(x[, i[, j]])    numeric occurence of x in string s, optional i thru j chars
# s.count(x)     # of times x appears in string s
# 
# These examples are best done in VS Code,
# considering that grasshopper and ghpython are best suited for number params in my opinion.
# Some text scripts will start to become important for
# masking and manipulating datatrees in the sets tab
# Calculating timespans
# timespan
# 
# datetime.timedelta class
# check type for class details, new datatype
# 
# Accounting for Time Zones
# 
# search the web for time zone map
# (UTC) and (GMT) used by military
# Universal Time Coordinate
# 
# Current timezones
# Olson database or tz database
# 
# Sample Time Zones forn the Olson Database
# see online
# 
# Python works wht two different types:
# Naive datetime
# Aware datetime
# 
# Working with Time Zones
# .now()
# .utc_now()
# 
# import dateutils package
# get gettz
# 
# from dateutil.tz import gettz
# gettz('name')
# 
# i.e.
# utc = dt.datetime.now(gettz('Etc/UTC'))
# est = dt.datetime.now(gettz('America/New_York'))
# 
# event = dt.datetime(2020,7,4,19,0,0)
# 
# #Show("Local: " + f{event:%D %I: %M %p %Z}" + "\n")
# 
# name = event.astimezone(gettz("tzmname"))
# .astimezone(gettz("tzname")) is built-in dateutil function
# 
# Check out the arrow module for more information!
# ASCII characters
# American Standard Code for Information Interchange (ASCII)
# 0-31 are control characters (Ctrl-key activated)
# 
# ord() function
# print(ord("A"))
# prints 65
# 
# chr() function does the opposite
# chr(65)
# prints "A"
# Manipulating string with methods
# 
# str object verses old string object in python 2.0
# string.methodman(params)
# Built-in Methods for Python 3 Strings
# s.capitalize()
# s.count(x, [y, z])
# s.find(x, [y, z])
# .index(x, [y, z])
# s.isalpha()
# s.isdecimal()
# s.isnumeric()
# s.isprintable()
# s.istitle()
# s.isupper()
# s.lower()
# s.lstrip()
# s.replace(x, y)
# s.rfind(x, [y, z])
# s.rindex()
# s.rstrip()
# s.swapcase()
# s.title()
# s.upper()
ord_chr = GhPythonScript()  # -> out, a
# ---------- ord_chr: Python ----------
import rhinoscriptsyntax as rs

print(ord("A"))

print(chr(65))
# ---------- end ord_chr ----------
concatenatename = GhPythonScript()  # -> out, a
# ---------- concatenatename: Python ----------
import rhinoscriptsyntax as rs

first_name = "Mike"
middle_name = "Elvis"
last_name = "Wickerson"
full_name = first_name+middle_name+last_name
print(full_name)
full_name = first_name + " " + middle_name + " " + last_name
print(full_name)
# ---------- end concatenatename ----------
stringoperators = GhPythonScript()  # -> out, a
# ---------- stringoperators: Python ----------
import rhinoscriptsyntax as rs

s = "Abracadabra Hocus Pocus you're a turtle dove"
# Is there a lowercase letter t in s?
print("t" in s)
#Print 15 hypens in a row
print(15 * "-")
print(s[0])
print(s[33:39])
print(s[3:34:3])
print(min(s))
print(max(s))
print(s.index("P"))
print(s.index("u",0,23))
print(s.count("a"))
# ---------- end stringoperators ----------
panel_15 = Panel(concatenatename.out)
panel_16 = Panel(ord_chr.out)
panel_17 = Panel(stringoperators.out)
