# Grasshopper definition AIO_python_B2_002_SB.gh (Grasshopper 1.0.7)
# plug-ins: LunchBox

number_slider = Slider(1, range=0..1)  # disabled
# Sand Box
number_slider_2 = Slider(45, range=0..100)  # disabled
number_slider_3 = Slider(6, range=0..10)  # disabled
range = Range(Domain=number_slider, Steps=expr("x-1", number_slider_3))  # disabled
range_2 = Range(Domain=number_slider_2, Steps=expr("x-1", number_slider_3))  # disabled
boolean_toggle = BooleanToggle(True)  # disabled
ifstatement = GhPythonScript(totalIn=range_2, scaleIn=range, TorF=boolean_toggle)  # -> out, totalOut; inputs totalIn: Int32, TorF: Boolean; disabled
# ---------- ifstatement: Python ----------
import rhinoscriptsyntax as rs

# must eliminate Python 3.0 f-string info in python 2.7
total = totalIn
sales_tax_rate = scaleIn 
taxable = TorF
if taxable:
    print("Subtotal: " + str(total))
    sales_tax = (total * sales_tax_rate)
    print("Sales Tax: " + str(sales_tax))
    total = (total + sales_tax)
print("Total: " + str(total))

totalOut = (total + sales_tax)
# ---------- end ifstatement ----------
circle = Circle(Plane=PlaneXY(0, 0, 0), Radius=ifstatement.totalOut)  # disabled
panel = Panel("0")  # disabled
panel_2 = Panel(ifstatement.out)  # disabled
panel_3 = Panel(ifstatement.totalOut)  # disabled
cull_index = CullIndex(List=circle, Indices=panel, Wrap=True)  # disabled
range_3 = Range(Domain=ifstatement.totalOut, Steps=expr("x-1", number_slider_3))  # disabled
divide_curve = DivideCurve(Curve=reparameterize(cull_index), Count=number_slider_3, Kinks=False)  # -> Points, Tangents, Parameters; disabled
cull_index_2 = CullIndex(List=range_3, Indices=panel, Wrap=True)  # disabled
range_4 = Range(Domain=ifstatement.totalOut, Steps=expr("x-1", number_slider_3))  # disabled
circle_2 = Circle(Plane=divide_curve.Points, Radius=cull_index_2)  # disabled
unit_z = UnitZ(Factor=range_4)  # disabled
number_slider_4 = Slider(0.15, range=0..1)  # disabled
move = Move(Geometry=circle_2, Motion=unit_z)  # -> Geometry, Transform; disabled
evaluate_curve = EvaluateCurve(Curve=reparameterize(move.Geometry), Parameter=number_slider_4)  # -> Point, Tangent, Angle; disabled
interpolate = Interpolate(Vertices=evaluate_curve.Point, Degree=3, Periodic=False, KnotStyle=1)  # -> Curve, Length, Domain; disabled
loft = Loft(
    Curves=flatten(interpolate.Curve),
    Options={Adjust=False, Closed=False, LoftEnds=0, LoftSimp=0, LoftType=0, Rebuild=10, Refit=0.01})  # disabled
number_slider_5 = Slider(9, range=0..10)  # disabled
deconstruct_brep = DeconstructBrep(Brep=loft)  # -> Faces, Edges, Vertices; disabled
divide_surface = DivideSurface(Surface=reparameterize(deconstruct_brep.Faces), UCount=number_slider_5, VCount=number_slider_5)  # -> Points, Normals, Parameters; disabled
panel_4 = Panel("0")  # disabled
amplitude = Amplitude(Vector=divide_surface.Normals, Amplitude=Slider(10, range=0..10))  # disabled
cull_index_3 = CullIndex(List=divide_surface.Points, Indices=panel_4, Wrap=True)  # -> flatten(List); disabled
negative = Negative(Value=amplitude)  # disabled
move_2 = Move(Geometry=graft(cull_index_3), Motion=negative)  # -> Geometry, Transform; disabled
interpolate_2 = Interpolate(Vertices=move_2.Geometry, Degree=3, Periodic=False, KnotStyle=1)  # -> Curve, Length, Domain; disabled
loft_2 = Loft(
    Curves=flatten(interpolate_2.Curve),
    Options={Adjust=False, Closed=False, LoftEnds=0, LoftSimp=0, LoftType=0, Rebuild=10, Refit=0.01})  # disabled

ifstatement_2 = GhPythonScript(TorF=Toggle(True))  # -> out; inputs TorF: Boolean
# ---------- ifstatement_2: Python ----------
import rhinoscriptsyntax as rs

# must eliminate Python 3.0 f-string info in python 2.7
total = 100
sales_tax_rate = 0.065 
taxable = TorF
if taxable:
    print("Subtotal: " + str(total))
    sales_tax = (total * sales_tax_rate)
    print("Sales Tax: " + str(sales_tax))
    total = (total + sales_tax)
print("Total: " + str(total))
# ---------- end ifstatement_2 ----------
panel_5 = Panel(ifstatement_2)
# Ternary operations
# age = 31
# if age < 21:
#     beverage = "milk"
# elif age >= 21 and age < 80:
#     beverage = "beer"
# else:
#     beverage = "prune juice"
# 
# print("Have a " + beverage)
if_elif_else = GhPythonScript()  # -> out
# ---------- if_elif_else: Python ----------
import rhinoscriptsyntax as rs

#Ternary operations
age = 31
if age < 21:
    beverage = "milk"
elif age >= 21 and age < 80:
    beverage = "beer"
else:
    beverage = "prune juice"

print("Have a " + beverage)
# ---------- end if_elif_else ----------
# Python
# all-in-one for dummies, John C. Shovic, Phd and Alan Simpson, 2nd Edition, 2021
# Book 2
# Chapter 2
# Controlling the Action
# the doign and the action
# 
# Main Operators for Controlling the Action
# Relational operators
# Comparison operators
# 
# Python Comparison Operators for Decision-Making
# ==
# !=
# <
# >
# <=
# >=
# 
# Python Logical Operators
# and
# or not
# 
# WEB: George Boole
# if then else
# decision control
# if statement
# 
# Making Decisions with if
# 
# if contion: do this
# do this no matter what
# 
# sun = "down"
# if sun == "down": print("Good night")
# print("I am here")
# 
# == is not = (assignment)
# it is equality checking with bool outcome
# condition is true or false
# 
# sun = "up"
# if sun == "down": print("Good night")
# print("I am here")
# 
# indentation is usually PEP 8 ... 4x space
# can be any spacing so long as it is consistent in code block
# 
# if condition:
#     do this
# do this no matter what
# 
# sun = "down"
# if sun == "down":
#     print("Good night!")
# print("I am here")
# 
# i.e. Total Sale
# total = 100
# sales_tax_rate = 0.065
# taxable = True
# if taxable:
#     print(f"Subtotal : ${total:.2f}")
#     sales_tax = total * sales_tax_rate
#     print(f"Sales Tax: ${sales_tax:.2f}")
#     total = total + sales_tax
# print(f"Total      :{total:.2f}")
# 
# if taxable:
# if taxable == True:
# 
# total = 100
# sales_tax_rate = 0.065
# taxable = False
# if taxable:
#     print(f"Subtotal : ${total:.2f}")
#     sales_tax = total * sales_tax_rate
#     print(f"Sales Tax: ${sales_tax:.2f}")
#     total = total + sales_tax
# print(f"Total      :{total:.2f}")
# Hamdling multiple else statements with elif
# 
# elif statements
# 
# if condition:
#     do these indented lines of code
# elif condition:
#     do these indented lines of code
# do these un-indented lines of code no matter what
# 
# light_color = "green"
# if light_color == "green":
#     print("Go")
# elif light_color == "red":
#     print("Stop")
# else:
#     print("Proceed with caution")
# print("This code executes no matter what")
else = GhPythonScript()  # -> out
# ---------- else: Python ----------
import rhinoscriptsyntax as rs

import datetime as dt
# Get the current date and time
now = dt.datetime.now()
# Make a decision based on hour
if now.hour < 12:
    print("Good morning")
else:
    print("Good afternoon")
print("I hope you are doing well!")
# ---------- end else ----------
if_elif_else2 = GhPythonScript()  # -> out
# ---------- if_elif_else2: Python ----------
import rhinoscriptsyntax as rs

light_color = "green"
if light_color == "green":
    print("Go")
elif light_color == "red":
    print("Stop")
else:
    print("Proceed with caution")
print("This code executes no matter what")
# ---------- end if_elif_else2 ----------
# Adding else to your if logic
# 
# if condition:
#     do indented lines here
# else:
#     do intended lines here
# do remaining un-dented lines no matter that
# 
# import datetime as dt
# # Get the current date and time
# now = dt.datetime.now()
# # Make a decision based on hour
# if now.hour < 12:
#     print("Good morning")
# else:
#     print("Good afternoon")
# print("I hope you are doing well!")
panel_6 = Panel(else)
panel_7 = Panel(if_elif_else)
panel_8 = Panel(if_elif_else2)
forloop = GhPythonScript()  # -> out
# ---------- forloop: Python ----------
import rhinoscriptsyntax as rs

for x in range(7):
    print(x)
print("All done")
# ---------- end forloop ----------
forloop2 = GhPythonScript()  # -> out
# ---------- forloop2: Python ----------
import rhinoscriptsyntax as rs

for x in range(1, 10):
    print(x)
print("All done")
# ---------- end forloop2 ----------
forloopstep = GhPythonScript()  # -> out
# ---------- forloopstep: Python ----------
import rhinoscriptsyntax as rs

for x in range(1, 10, 2):
    print(x)
print("All done")
# ---------- end forloopstep ----------
# Repeating a Process with for
# 
# for loop
# 
# for x in range(y):
#     do this
#     do this
# un-indented code is executed after the loop
# 
# for x in range(7):
#     print(x)
# print("All done")
panel_9 = Panel(forloop)
panel_10 = Panel(forloopstep)
panel_11 = Panel(forloop2)

range_5 = Range(Domain=Domain(0, 1), Steps=10)
series = Series(Start=0, Step=1, Count=10)
forloopstep_2 = GhPythonScript()  # -> out; same code as forloopstep
panel_12 = Panel(forloopstep_2)

# ----
# Looping through a string
# 
# range()
# 
# for x in string:
#     do this
#     do this
# do this when the loop is done
# 
# for x in "snorkel":
#     print(x)
# print("Done")
# Looping through a list
# 
# for x in ["The", "rain", "in", "Spain"]
#     print(x)
# print("Done")
forloopstring = GhPythonScript()  # -> out
# ---------- forloopstring: Python ----------
import rhinoscriptsyntax as rs

for x in "snorkel":
    print(x)
print("Done")
# ---------- end forloopstring ----------
# Bailing out of a loop
# 
# break
# 
# for x in items:
#     if condition:
#         [do this...]
#         break
#     do this
# 
# answers = ["A", "B", "C", "D"]
# for answer in answers:
#     if answer == "":
#         print("Incomplete")
#         break
#     print(answer)
# print("Loop is done")
forlooplist = GhPythonScript()  # -> out
# ---------- forlooplist: Python ----------
import rhinoscriptsyntax as rs

for x in ["The", "rain", "in", "Spain"]:
    print(x)
print("Done")
# ---------- end forlooplist ----------
break2 = GhPythonScript()  # -> out
# ---------- break2: Python ----------
import rhinoscriptsyntax as rs

answers = ["A", "B", "", "D"]
for answer in answers:
    if answer == "":
        print("Incomplete")
        break
    print(answer)
print("Loop is done")
# ---------- end break2 ----------
break = GhPythonScript()  # -> out
# ---------- break: Python ----------
import rhinoscriptsyntax as rs

answers = ["A", "B", "C", "D"]
for answer in answers:
    if answer == "":
        print("Incomplete")
        break
    print(answer)
print("Loop is done")
# ---------- end break ----------
# Looping with continue
# Nesting loops
continue = GhPythonScript()  # -> out
# ---------- continue: Python ----------
import rhinoscriptsyntax as rs

answers = ["A", "B", "", "D"]
for answer in answers:
    if answer == "":
        print("Incomplete")
        continue
    print(answer)
print("Loop is done")
# ---------- end continue ----------
nesting = GhPythonScript()  # -> out
# ---------- nesting: Python ----------
import rhinoscriptsyntax as rs

# Outer Loop
for outer in ["First", "Second", "Third"]:
    print(outer)
    # Inner Loop
    for inner in range(3):
        print(inner + 1)

print("Both loops are done")
# Out of both Loops here
# ---------- end nesting ----------
panel_13 = Panel(forlooplist)
panel_14 = Panel(break2)
panel_15 = Panel(break)
panel_16 = Panel(continue)
panel_17 = Panel(nesting)
# Looping with while
# 
# while condition:
#     do this
#     do this
# do this when the loop is done
# 
# beware condition to stop infinite loop and CRASH!
# 
# variable counter
# += 1
# -= 1
# 
# chr() from 65-90
# 
# counter = 65
# while counter < 91:
#     print(str(counter) + "=" + chr(counter))
#     counter += 1
# print("all done")
panel_18 = Panel(forloopstring)
whileloop = GhPythonScript()  # -> out
# ---------- whileloop: Python ----------
import rhinoscriptsyntax as rs

counter = 65
while counter < 91:
    print(str(counter) + "=" + chr(counter))
    counter += 1
print("all done")
# ---------- end whileloop ----------
# Starting while loops over with continue
# 
# * Note Stop infinite loops in Jupyter Notebooks with red button STOP
whileloopcontinue = GhPythonScript()  # -> out
# ---------- whileloopcontinue: Python ----------
import rhinoscriptsyntax as rs
import random

print("Odd numbers")
counter = 0
while counter < 10:
    # Get a random number
    number = random.randint(1, 999)
    if int(number / 2) == number /2:
        # If it's an even number, don't print it.
        continue
    #Otherwise, if it's odd, print it and increment the counter.
    print(number)
    #Increment the Loop counter.
    counter += 1
print("Loop is done")
# ---------- end whileloopcontinue ----------
whileloopbreak = GhPythonScript()  # -> out
# ---------- whileloopbreak: Python ----------
import rhinoscriptsyntax as rs
import random

print("Numbers that aren't evenly divisible by 5")
counter = 0
while counter < 10:
    # Get a random number
    number = random.randint(1, 999)
    if int(number / 5) == number / 5:
        # If it's enenly divisible by 5, bail out.
        break
    # Otherwise, print it and keep going for a while.
    print(number)
    #Increment the Loop counter.
    counter += 1
print("Loop is done")
# ---------- end whileloopbreak ----------
panel_19 = Panel(whileloop)
panel_20 = Panel(whileloopcontinue)
panel_21 = Panel(whileloopbreak)
boolean_toggle_2 = BooleanToggle(True)
whileloopbreak_2 = GhPythonScript(boolIn=boolean_toggle_2)  # -> out, number, listA; inputs boolIn: Boolean
# ---------- whileloopbreak_2: Python ----------
import rhinoscriptsyntax as rs
import random


print("Numbers that aren't evenly divisible by 5")
if boolIn:
    listA = []
    counter = 0
    while counter < 10:
        # Get a random number
        number = random.randint(1, 99)
        if int(number / 5) == number / 5:
            # If it's enenly divisible by 5, bail out.
            break
        # Otherwise, print it and keep going for a while.
        print(number)
        listA.append(number)
        #Increment the Loop counter.
        counter += 1
    print("Loop is done")
# ---------- end whileloopbreak_2 ----------
whileloopbreak_3 = GhPythonScript(boolIn=boolean_toggle_2)  # -> out, number, listA; inputs boolIn: Boolean; same code as whileloopbreak_2
whileloopcontinue_2 = GhPythonScript()  # -> out; same code as whileloopcontinue
param_viewer = ParamViewer(whileloopcontinue_2)
panel_22 = Panel(whileloopbreak_3.out)
panel_23 = Panel(whileloopbreak_3.listA)
panel_24 = Panel(whileloopbreak_2.out)
panel_25 = Panel(whileloopbreak_2.listA)
panel_26 = Panel(whileloopcontinue_2)
list_item = ListItem(List=panel_25, Index=0, Wrap=True)  # -> Item1, Item
list_item_2 = ListItem(List=panel_23, Index=0, Wrap=True)  # -> Item1, Item
range_6 = Range(Domain=list_item_2.Item1, Steps=10)
range_7 = Range(Domain=list_item.Item1, Steps=10)
param_viewer_2 = ParamViewer(whileloopbreak_2.listA)
param_viewer_3 = ParamViewer(whileloopbreak_3.listA)
construct_point = ConstructPoint(XCoordinate=0, YCoordinate=0, ZCoordinate=range_6)
construct_point_2 = ConstructPoint(XCoordinate=0, YCoordinate=0, ZCoordinate=range_7)
polygon = Polygon(Plane=construct_point, Radius=panel_23, Segments=list_item_2.Item1, FilletRadius=0)  # -> graft(Polygon), Length
polygon_2 = Polygon(Plane=construct_point_2, Radius=panel_25, Segments=list_item.Item1, FilletRadius=0)  # -> graft(Polygon), Length
loft_3 = Loft(
    Curves=[polygon.Polygon, polygon_2.Polygon],
    Options={Adjust=False, Closed=False, LoftEnds=0, LoftSimp=0, LoftType=0, Rebuild=10, Refit=0.01})
object_bake = ObjectBake(
    BakeToggle=Toggle(True),
    GeometryObjects=loft_3,
    Layer="GH_Bake",
    ObjectName="GH_Obj",
    ObjectColor=RGB(255, 255, 255),
    LayerColor=RGB(255, 255, 255))
