# Grasshopper definition AIO_python_B2_003f_SB.gh (Grasshopper 1.0.7)
# plug-ins: LunchBox, Kangaroo2 Components, FlexHopper

# ----
# The Death Star (random size and appearance)
number_slider = Slider(2, range=1..5)
listcontains = GhPythonScript(rangeHigh=Slider(25, range=0..25), count=Slider(20, range=0..25), num=number_slider)  # -> out, numList, numListNew; inputs rangeHigh: Int32, count: Int32, num: Int32
# ---------- listcontains: Python ----------
import rhinoscriptsyntax as rs

# Python code to demonstrate
# to generate random number list
# using list comprehension + randrange()
import random
 
# using list comprehension + randrange()
# to generate random number list
numList = [random.randrange(1, rangeHigh, 1) 
for i in range(count)]

# printing result
print ("Random number list is : " +  str(numList))

# Is num in list?
has_num = num in numList
print(has_num)
# Is numSquared in list?
has_numSquared = (num * num) in numList
print(has_numSquared)

if (has_num == True & has_numSquared == True):
    numListNew = [num, num * num]
else:
    numList = []
# ---------- end listcontains ----------
panel = Panel(listcontains.numList)
list_length = ListLength(List=flatten(listcontains.numList))
panel_2 = Panel(listcontains.out)
construct_point = ConstructPoint(XCoordinate=listcontains.numListNew, YCoordinate=listcontains.numListNew, ZCoordinate=0)
panel_3 = Panel(listcontains.numListNew)
square_root = SquareRoot(Value=list_length)
sphere = Sphere(Base=graft(construct_point), Radius=graft(listcontains.numListNew))
integer = Integer(square_root)
dispatch = Dispatch(List=flatten(sphere), DispatchPattern=[True, False])  # -> ListA, ListB
square = Square(Plane=PlaneXY(0, 0, 0), Size=Slider(20, range=0..20), ExtentX=integer, ExtentY=integer)  # -> Cells, flatten(Points)
list_item = ListItem(List=listcontains.numList, Index=0, Wrap=True)
construct_point_2 = ConstructPoint(XCoordinate=0, YCoordinate=0, ZCoordinate=0)
solid_difference = SolidDifference(BrepsA=dispatch.ListB, BrepsB=dispatch.ListA)
list_item_2 = ListItem(List=square.Points, Index=list_item, Wrap=True)
orient = Orient(Geometry=solid_difference, Source=construct_point_2, Target=list_item_2)  # -> Geometry, Transform
object_bake = ObjectBake(
    BakeToggle=Toggle(False),
    GeometryObjects=orient.Geometry,
    Layer="GH_Bake",
    ObjectName="GH_Obj",
    ObjectColor=RGB(255, 255, 255),
    LayerColor=RGB(255, 255, 255))

# ----
# Getting the length of a list
# 
# len() function
# item -1 starts at "0"
# 
# Adding an item to the end of a list
# .append()
# students.append(new_student)
# no need to set to new variable
# this adds to the existing list students
# 
# #conditional append with if/else statement
# students = ["Oscar", "Max", "Ella"]
# student_name = "Michael"
# if student_name in students:
#     print(student_name + " already in the list")
# else:
#     students.append(student_name)
#     print(student_name + " addend to the list")
listcontains_2 = GhPythonScript()  # -> out
# ---------- listcontains_2: Python ----------
import rhinoscriptsyntax as rs

students = ["Oscar", "Max", "Ella"]
# Is Ella in list?
has_Ella = "Ella" in students
print(has_Ella)
# Is Peter in list?
has_Peter = "Peter" in students
print(has_Peter)
# ---------- end listcontains_2 ----------
# Sand Box
conditionalappend = GhPythonScript()  # -> out
# ---------- conditionalappend: Python ----------
import rhinoscriptsyntax as rs

#conditional append with if/else statement

students = ["Oscar", "Max", "Ella"]
student_name = "Michael"
if student_name in students:
    print(student_name + " already in the list")
else:
    students.append(student_name)
    print(student_name + " append to the list")
# ---------- end conditionalappend ----------
panel_4 = Panel(listcontains_2)

# ----
# Cage in Cage
number_slider_2 = Slider(25, range=0..25)
conditionalappend_2 = GhPythonScript(rangeHigh=number_slider_2, count=Slider(25, range=0..25), num=Slider(4, range=2..5))  # -> out, numList1, numList2, numListNew1, numListNew2; inputs rangeHigh: Int32, count: Int32, num: Int32
# ---------- conditionalappend_2: Python ----------
import rhinoscriptsyntax as rs

# Python code to demonstrate
# to generate random number list
# using list comprehension + randrange()
import random
 
# using list comprehension + randrange()
# to generate two random number list
numList1 = [random.randrange(1, rangeHigh, 1) 
for i in range(count)]

numList2 = [random.randrange(1, rangeHigh, 1) 
for i in range(count)]

# printing result
print ("Random number list1 is : " +  str(numList1))
print ("Random number list2 is : " +  str(numList2))

#conditional append with if/else statement
# Is num in list1?
has_num = num in numList1
print(has_num)
# Is numSquared in list1?
has_numSquared = (num * num) in numList1
print(has_numSquared)

if has_num in numList1:
    print(num)
    print(num * num)

if (has_num == True & has_numSquared == True):
    numListNew1 = [num, num * num]
else:
    numList1 = []
    
#conditional append with if/else statement
# Is num in list2?
has_num = num in numList2
print(has_num)
# Is numSquared in list2?
has_numSquared = (num * num) in numList2
print(has_numSquared)

if has_num in numList2:
    print(num)
    print(num * num)

if (has_num == True & has_numSquared == True):
    numListNew2 = [num, num * num]
else:
    numList2 = []
# ---------- end conditionalappend_2 ----------
panel_5 = Panel(conditionalappend_2.numList1)
panel_6 = Panel(conditionalappend_2.out)
circle = Circle(Plane=PlaneXY(0, 0, 0), Radius=conditionalappend_2.numListNew1)
circle_2 = Circle(Plane=PlaneXY(0, 0, 0), Radius=conditionalappend_2.numListNew1)
panel_7 = Panel(conditionalappend_2.numList2)
move = Move(Geometry=circle, Motion=Vector(0, 0, 10))  # -> Geometry, Transform
panel_8 = Panel(conditionalappend_2.numListNew1)
divide_curve = DivideCurve(Curve=move.Geometry, Count=conditionalappend_2.numListNew2, Kinks=False)  # -> Points, Tangents, Parameters
divide_curve_2 = DivideCurve(Curve=circle_2, Count=conditionalappend_2.numListNew2, Kinks=False)  # -> Points, Tangents, Parameters
panel_9 = Panel(conditionalappend_2.numListNew2)
line = Line(StartPoint=divide_curve_2.Points, EndPoint=divide_curve.Points)  # -> flatten(Line)
merge = Merge(Data1=circle_2, Data2=move.Geometry, Data3=line)
multipipe = MultiPipe(
    Curves=flatten(merge),
    NodeSize=Slider(0.86, range=0..2),
    EndOffset=1,
    StrutSize=1,
    Segment=0,
    KinkAngle=0.6,
    CubeFit=0,
    Caps=0)
stream_filter = StreamFilter(Gate=Toggle(True), Stream1=multipipe)
instant_bake = InstantBake(Objects=flatten(stream_filter), LayerName="Default", ClearLayer=False)

panel_10 = Panel(conditionalappend)
# Removing list items
# 
# letters = ["A", "B", "item", "C", "item"]
# 
# .remove("item")
# while "item" in letters:
#     letters.remove("item")
# print(letters)
combining = GhPythonScript()  # -> out
# ---------- combining: Python ----------
import rhinoscriptsyntax as rs

list1 = [1,2,3,4,5]
list2 = [6,7,8,9]

list1.extend(list2)
print(list1)
# ---------- end combining ----------
# .pop()
# first and last and anything inbetween
# 
# letters = ["A", "B", "item", "C", "item"]
# 
# # Remove the first item.
# first_removed = letters.pop(0)
# # Remove the last item.
# last_removed = letters.pop()
# 
# # Show me the new list.
# print(letters)
# print(first_removed + " and" + last_removed + " were removed")
# it is possible to store copies of the popped items in variables
removing = GhPythonScript()  # -> out
# ---------- removing: Python ----------
import rhinoscriptsyntax as rs

letters = ["A", "B", "item", "C", "item"]

while "item" in letters:
    letters.remove("item")
print(letters)
# ---------- end removing ----------
# Changing an item in a list
# listname[index] = newvalue
# change variable value at index
# Combining lists
# original_list.extend(additional_items_list)
# list1 = [1,2,3,4,5]
# list2 = [6,7,8,9]
# 
# list1.extend(list2)
# print(list1)
changingitem = GhPythonScript()  # -> out
# ---------- changingitem: Python ----------
import rhinoscriptsyntax as rs

students = ["Oscar", "Max", "Ella"]
students[1] = "Michael"
print(students)
# ---------- end changingitem ----------
pop = GhPythonScript()  # -> out
# ---------- pop: Python ----------
import rhinoscriptsyntax as rs

letters = ["A", "B", "item", "C", "item"]

# Remove the first item.
first_removed = letters.pop(0)
# Remove the last item.
last_removed = letters.pop()

# Show me the new list.
print(letters)
print(first_removed + " and " + last_removed + " were removed")
#it is possible to store copies of the popped items in variables
# ---------- end pop ----------
# Python
# all-in-one for dummies, John C. Shovic, Phd and Alan Simpson, 2nd Edition, 2021
# Book 2
# Chapter 3
# 
# Speeding Along with Lists and Tuples
# 
# one item at a time
# Lists and Arrays
# use Jupyter Notebooks or VS Code .py files
# 
# Defining and Using Lists
# simplest data collection
# [ , , , ]
# 
# Really, Really Long Lists
# use smaller internal databases to learn
# then move onto longer external databases on the cloud
# 
# Referencing list items by position
# listname[x]
# start counting indexes/elements at 0
# 
# when reading aloud use "listname sub numbe"
# i.e. students sub [0]
# 
# beware:
# index out of range error
# 
# Looping through a list
# for x in list:
# i.e.
# for score in scores:
#     print(score)
# *note the use of prural and singular names
# 
# Seeing whether a list contains an item
# use in listname
# i.e.
# students = ["Oscar", "Max", "Ella"]
# # Is Ella in list?
# has_Ella = "Ella" in students
# print(has_Ella)
# # Is Peter in list?
# has_Peter = "Peter" in students
# print(has_Peter)
insert = GhPythonScript()  # -> out
# ---------- insert: Python ----------
import rhinoscriptsyntax as rs

students = ["Oscar", "Max", "Ella"]
student_name = "Michael"
# Add student name to front of list.
students.insert(0, student_name)
# Show me the new list.
print(students)
# ---------- end insert ----------
panel_11 = Panel(pop)
panel_12 = Panel(combining)
panel_13 = Panel(changingitem)
panel_14 = Panel(removing)
# Inserting an item into a list
# listname.insert(position, item)
# 
# students = ["Oscar", "Max", "Ella"]
# student_name = "Michael"
# # Add student name to front of list.
# students.insert(0, student_name)
# # Show me the new list.
# print(students)
panel_15 = Panel(insert)
# Finding a list item's index
# 
# listname.index(x)
# 
# error occurs if literal is not in the list
# 
# #Create a list of strings
# grades = ["A", "A", "B", "C", "D", "D", "F"]
# 
# # Find the index for "B".
# b_index = grades.index("B")
# 
# # Find the index for G
# look_for = "G"
# g_index = grades.index(look_for)
# 
# # Show the results.
# print("the first B is index " + str(b_index)
# print("The first " + look_for + " is at " + str(g_index)
countingitemtimes = GhPythonScript()  # -> out
# ---------- countingitemtimes: Python ----------
import rhinoscriptsyntax as rs

#Create a List of Strings
grades = ["A", "A", "B", "C", "D", "D", "F"]

# count the "D"'s
d_grades = grades.count("D")

#Use a variable for value of count
look_for = "C"
c_grades = grades.count("look_for")

print("There are " + str(d_grades) + " D grades in the list.")
print("There are " + str(c_grades) + " " + look_for + " grades in the lst.")
print("There are " + str(grades.count("F")) + " F grades in the list.")
# ---------- end countingitemtimes ----------
findingindex = GhPythonScript()  # -> out
# ---------- findingindex: Python ----------
import rhinoscriptsyntax as rs

#Create a list of strings
grades = ["A", "A", "B", "C", "D", "D"]

# Find the index for "B".
b_index = grades.index("B")

# Find the index for F
look_for = "F"
f_index = grades.index(look_for)

# Show the results.
print("the first B is index " + str(b_index))
print("The first " + look_for + " is at " + str(f_index))
# ---------- end findingindex ----------

# ----
# clearing
# * NOTE not available in python 2.0
# 
# .clear() method
# for cleaqring contents only, not the list like del
# 
# letters = ["a", "b", "c", "d", "e"]
# letters.clear()
# parint(letters)
# Counting how many times an item appears in a list
# 
# listname.count(x)
# 
# use literals in quotes in list
# 
# #Create a List of Strings
# grades = ["A", "A", "B", "C", "D", "D", "F"]
# 
# # count the "D"'s
# d_brades = grades.count("D")
# 
# #Use a variable for value of count
# look_for = "C"
# c_grades = grades.count("look_for)
# 
# print("There are " + str(d_grades) + " D grades in the list.")
# print("There are " + str(c_grades) + " " + look_for + " grades in the lst.")
# print("There are " + str(grades.count("F")) + " F grades in the list.")
clearing = GhPythonScript()  # -> out
# ---------- clearing: Python ----------
import rhinoscriptsyntax as rs

#NOTE: not available in Python 2.0
letters = ["a", "b", "c", "d", "e"]
letters.clear()
print(letters)
# ---------- end clearing ----------
panel_16 = Panel(clearing)

# ----
# del
# 
# * new to me*
# 
# letters = ["a", "b", "c", "d", "e"]
# del letters[2]
# print(letters)
# 
# #error is item is not in list
del = GhPythonScript()  # -> out
# ---------- del: Python ----------
import rhinoscriptsyntax as rs

letters = ["a", "b", "c", "d", "e"]
del letters[2]
print(letters)

#error is item is not in list
# ---------- end del ----------
panel_17 = Panel(countingitemtimes)
panel_18 = Panel(findingindex)
panel_19 = Panel(del)
insert_2 = GhPythonScript()  # -> out; same code as insert
# Cage in Cage
panel_20 = Panel(insert_2)
# check out Book 2: Chapter 5 for .sort(key=lambda s: s.lower())
# 
# Dates are a little trickier
# You have to use the datetime module, they are not strings
# date()
# 
# dates = [dt.date(2020, 12, 31), dt.date(2019, 1, 31), dt.date(2018, 2, 28), dt.date(2020, 1,1)]
# 
# # Need this module for the dates.
# import datetime as dt
# 
# # Create a list of dates, empty for starters
# datelist = []
# #Append dates one at time so code is easier to read.
# datelist.append(dt.date(2020, 12, 31))
# datelist.append(dt.date(2019, 1, 31))
# datelist.append(dt.date(2018, 2, 28))
# datelist.append(dt.date(2020, 1,1))
# 
# # sort the dates (earliest to Latest) and show formatted
# datelist.sort()
# for date in datelist:
#     print(date)
#     #print(f"{date:%m/%d/%y}") if using Python3
alphabetize = GhPythonScript()  # -> out
# ---------- alphabetize: Python ----------
import rhinoscriptsyntax as rs

#sort() method
#sorted smallest to longest in strings

#listname.sort()

# Create a list of strings
names = ["Matthew", "Mark", "Buffalo", "Tom"]
# Create a list of numbers
numbers = [ 14, 0, 56, -4, 99, 56, 11, 23]

# Sort the names List.
names.sort()
# Sort the numbers List.
numbers.sort()

#Show the results
print(names)
print(numbers)
# ---------- end alphabetize ----------
sortdates = GhPythonScript()  # -> out
# ---------- sortdates: Python ----------
import rhinoscriptsyntax as rs

# Need this module for the dates.
import datetime as dt

# Create a list of dates, empty for starters
datelist = []
#Append dates one at time so code is easier to read.
datelist.append(dt.date(2020, 12, 31))
datelist.append(dt.date(2019, 1, 31))
datelist.append(dt.date(2018, 2, 28))
datelist.append(dt.date(2020, 1,1))

# sort the dates (earliest to Latest) and show formatted
datelist.sort()
for date in datelist:
    print(date)
    #print(f"{date:%m/%d/%y}") if using Python3
# ---------- end sortdates ----------
# Reverse Sort
# 
# reverse=True inside the sort()
reversesortdates = GhPythonScript()  # -> out
# ---------- reversesortdates: Python ----------
import rhinoscriptsyntax as rs

# Need this module for the dates.
import datetime as dt

# Create a list of strings
names = ["Matthew", "Mark", "Buffalo", "Tom"]
# Create a list of numbers
numbers = [ 14, 0, 56, -4, 99, 56, 11, 23]

# Create a list of dates, empty for starters
datelist = []
#Append dates one at time so code is easier to read.
datelist.append(dt.date(2020, 12, 31))
datelist.append(dt.date(2019, 1, 31))
datelist.append(dt.date(2018, 2, 28))
datelist.append(dt.date(2020, 1,1))

# Sort strings in reverse order (Z to A) and show
names.sort(reverse=True)
print(names)
print("") # This just adds a blank line to the output

#Sort numbers in reverse order (largest to smallest) and show formatted
numbers.sort(reverse=True)
print(numbers)
print("")

# sort the dates (earliest to Latest) and show formatted
datelist.sort(reverse=True)
for date in datelist:
    print(date)
    #print(f"{date:%m/%d/%y}") if using Python3
# ---------- end reversesortdates ----------
# Alphabetizing and sorting lists
# 
# sort() method
# sorted smallest to longest in strings
# 
# listname.sort()
# 
# # Create a list of strings
# names = ["Matthew", "Mark", "Buffalo", "Tom"]
# # Create a list of numbers
# numbers = [ 14, 0, 56, -4, 99, 56, 11, 23]
# 
# # Sort the names List.
# names.sort()
# # Sort the numbers List.
# numbers.sort()
# 
# #Show the results
# print(names)
# print(numbers)
panel_21 = Panel(alphabetize)
panel_22 = Panel(sortdates)
panel_23 = Panel(reversesortdates)
# Reversing  a list
# 
# .reverse method
# 
# #Create a list of strings
# names = ["Matthew", "Mark", "Buffalo", "Tom"]
# #reverse the list
# names.reverse()
# print(names)
# Copying a list
# 
# .copy() #not in Python 2.0
# 
# #Create a list of strings
# names = ["Matthew", "Mark", "Buffalo", "Tom"]
# #Make a copy
# backward_names = names.copy()
# #reverse copy
# backward_names.reverse()
# 
# print(names)
# print(backward_names)
reversinglist = GhPythonScript()  # -> out
# ---------- reversinglist: Python ----------
import rhinoscriptsyntax as rs

#Create a list of strings
names = ["Matthew", "Mark", "Buffalo", "Tom"]
#reverse the list
names.reverse()
print(names)
# ---------- end reversinglist ----------
copylist = GhPythonScript()  # -> out
# ---------- copylist: Python ----------
import rhinoscriptsyntax as rs

# Create a list of strings
names = ["Matthew", "Mark", "Buffalo", "Tom"]
# Make a copy
#not in Python 2.0
backward_names = names.copy()
#reverse copy
backward_names.reverse()

print(names)
print(backward_names)
# ---------- end copylist ----------
# append()
# clear()
# copy()
# count()
# extend()
# index()
# insert()
# pop()
# remove()
# reverse()
# sort()
# sort(reverse=True)
panel_24 = Panel(reversinglist)
panel_25 = Panel(copylist)

reversesortdates_2 = GhPythonScript()  # -> out, numbers; same code as reversesortdates
panel_26 = Panel(reversesortdates_2.out)
panel_27 = Panel(reversesortdates_2.numbers)

panel_28 = Panel("""29.95
9.98
4.95
79.98
2.95""")

eachitemintuple = GhPythonScript()  # -> out, a
# ---------- eachitemintuple: Python ----------
import rhinoscriptsyntax as rs

prices = (29.95, 9.98, 4.95, 79.98, 2.95)
#tuples cannot be modified

prices[1] = 234.45

print(prices)
# ---------- end eachitemintuple ----------
panel_29 = Panel(eachitemintuple.out)

tuple = GhPythonScript()  # -> out, a
# ---------- tuple: Python ----------
import rhinoscriptsyntax as rs

#What is a Tuple and Who Cares?

#two-pull
#( , , , )
prices = (29.95, 9.98, 4.95, 79.98, 2.95)
#tuples cannot be modified
print(prices)
# ---------- end tuple ----------
counttupleitems = GhPythonScript()  # -> out, a
# ---------- counttupleitems: Python ----------
import rhinoscriptsyntax as rs

prices = (29.95, 9.98, 4.95, 79.98, 2.95)
#tuples cannot be modified

# Get the length of a tuple
print(len(prices))
# ---------- end counttupleitems ----------
itemoccurance = GhPythonScript()  # -> out, a
# ---------- itemoccurance: Python ----------
import rhinoscriptsyntax as rs

prices = (29.95, 9.98, 4.95, 79.98, 2.95)
#tuples cannot be modified

#count the number of times it appears in a tuple
print(prices.count(4.95))
# ---------- end itemoccurance ----------
checkintuple = GhPythonScript()  # -> out, a
# ---------- checkintuple: Python ----------
import rhinoscriptsyntax as rs

prices = (29.95, 9.98, 4.95, 79.98, 2.95)
#tuples cannot be modified

# Check if it is inside a tuple
print(4.95 in prices)
# ---------- end checkintuple ----------
eachitemintuple_2 = GhPythonScript()  # -> out, a
# ---------- eachitemintuple_2: Python ----------
import rhinoscriptsyntax as rs

prices = (29.95, 9.98, 4.95, 79.98, 2.95)
#tuples cannot be modified

# Loop through and display each item in the tuple.
for price in prices:
    #print(f"${price:.2f}")
    print(price)
# ---------- end eachitemintuple_2 ----------
# What is a Tuple and Who Cares?
# 
# two-pull
# ( , , , )
# prices = (29.95, 9.98, 4.95, 79.98, 2.95)
# #tuples cannot be modified
# 
# # Get the length of a tuple
# print(len(prices))
# #count the number of times it appears in a tuple
# print(prices.count(4.95))
# # Check if it is inside a tuple
# print(4.95 in prices)
# 
# look_for = 12345
# if look_for in prices:
#     position = prices.index(look_for)
# else:
#     position = -1
# print(position)
# 
# # Loop through and display each item in the tuple.
# for price in prices:
#     #print(f"${price:.2f}")
#     print(price)
# 
# prices[1] = 234.45
# FAILURE!!!
#  So the list methods .append(), .clear(), .copy(), .extend(),
# .insert(), .pop(), .remove(), .reverse(), and .sort()
# would fail when working with tuples.
panel_30 = Panel(tuple.out)
jitter = Jitter(List=panel_28, Jitter=Slider(1, range=0..1), Seed=2)  # -> Values, Indices
panel_31 = Panel(itemoccurance.out)
panel_32 = Panel(counttupleitems.out)
panel_33 = Panel(checkintuple.out)
checkifintuple = GhPythonScript(x=jitter.Values)  # -> out, a
# ---------- checkifintuple: Python ----------
import rhinoscriptsyntax as rs

prices = (29.95, 9.98, 4.95, 79.98, 2.95)
#tuples cannot be modified

look_for = x
if look_for in prices:
    position = prices.index(look_for)
else:
    position = -1
print(position)
# ---------- end checkifintuple ----------
panel_34 = Panel(eachitemintuple_2.out)
panel_35 = Panel(checkifintuple.out)
sets = GhPythonScript()  # -> out, a
# ---------- sets: Python ----------
import rhinoscriptsyntax as rs
"""
Working with Sets

sets have no specific order
no index numbers in sets
"""
sample_set = {1.98, 98.3,  34.43,  2.5,  3, 12.2}
"""
use len()
Use in to determine an item in set

Can't sort() or set .reverse()

.add() a single new item to set
sample_set.add(11.23)
can only have one of these added values no matter how many times added

add multiple items with .update()
sample_set.update([66, 76.4, 23.34])
# in the form of an added unordered list


copy a set out of order
"""
#Define a set names sample_set above
#Show the whole set
print(sample_set)
# Make a copy of the set and show
ss2 = sample_set.copy()
print(ss2)

print(len(sample_set))
print(74.56 in sample_set)
# python f-string
# print(f"{price:>6.2f}")
# ---------- end sets ----------
# Working with Sets
# 
# sets have no specific order
# no index numbers in sets
# 
# sample_set = {1.98, 98.3,  34.43,  2.5,  3, 12.2}
# 
# use len()
# Use in to determine an item in set
# 
# Can't sort() or set .reverse()
# 
# .add() a single new item to set
# sample_set.add(11.23)
# can only have one of these added values no matter how many times added
# 
# add multiple items with .update()
# sample_set.update([66, 76.4, 23.34])
# # in the form of an added unordered list
# 
# 
# copy a set out of order
# 
# #Define a set names sample_set above
# #Show the whole set
# print(sample_set)
# # Make a copy of the set and show
# ss2 = sample_set.copy()
# print(ss2)
# 
# pritn(len(sample_set))
# print(74.56 in sample_set)
# # python f-string
# # print(f"{price:>6.2f}")
panel_36 = Panel(sets.out)
